# Grasshopper definition Bot.gh (Grasshopper 1.0.4)

timer = Timer(TimerInterval=1000, Target=bool)
bool = Boolean([True, False])
path = FilePath("C:\Users\Sjaak\Documents\GitHub\TwitchBot\Output.txt")
python = GhPythonScript(x=path, y=bool)  # -> flatten(out), a
# ---------- python: Python ----------
__author__ = "Sjaak"
__version__ = "2018.03.10"

import rhinoscriptsyntax as rs
if y == True:
    f = open(x, "r")
    lines = f.readlines()
    f.close
    for line in lines:
        print line
else: pass
# ---------- end python ----------
panel = Panel(python.out)
cull = CullPattern(List=python.out, CullPattern=[True, False])
panel_2 = Panel(cull)
lng = ListLength(List=cull)
subtraction = Subtraction(A=lng, B=Slider(1, range=0..1))
subtraction_2 = Subtraction(A=subtraction, B=Slider(10, range=0..100))
panel_3 = Panel("""0,0,0
0,-2,0
0,-4,0
0,-6,0
0,-8,0
0,-10,0
0,-12,0
0,-14,0
0,-16,0
0,-18,0
0,-20,0""")
dom = ConstructDomain(DomainStart=subtraction_2, DomainEnd=subtraction)
subset = SubList(List=cull, Domain=dom, Wrap=True)  # -> flatten(List), Index
pt = Point(panel_3)
tag = TextTag3D(Location=pt, Text=subset.List, Size=1, Justification=7)
